# Grasshopper definition TrianglesCircles-NotchesV3.gh (Grasshopper 0.9.80)

# Radius for the core
# triangle shape
triangleradius = Slider(26.638, range=0..40)
# Number of sides
# for the main piece
number_slider = Slider(3, range=0..20)
# Radius for the circles
# in the corners of the
# triangle shape
number_slider_2 = Slider(16.757, range=0..20)
notch_radius = Slider(3.74, range=0..10)
# This is for the notch
# shape and size settings.
notch_shape = Slider(4, range=0..10)
number_slider_3 = Slider(1, range=0..1)
construct_point = ConstructPoint(XCoordinate=0, YCoordinate=0, ZCoordinate=0)
sqrt_2 = SquareRoot(Value=2)
cir = Circle(Plane=PlaneXY(0, 0, 0), Radius=number_slider_2)
multiplication = Multiplication(A=notch_radius, B=2)
division = Division(A=triangleradius, B=2)
division_2 = Division(A=multiplication, B=sqrt_2)
multiplication_2 = Multiplication(A=number_slider_3, B=2)
_3x_notch_radius = Multiplication(A=notch_radius, B=3)
# These are the dimensions
# of the rectangle used for
# the connectors — based
# on the original notch sizes
_4x_notch_radius = Multiplication(A=notch_radius, B=4)
pt = ConstructPoint(XCoordinate=triangleradius, YCoordinate=0, ZCoordinate=0)
division_3 = Division(A=triangleradius, B=2)
multiplication_3 = Multiplication(A=multiplication_2, B=2)
addition = Addition(A=triangleradius, B=division)
half_notch_size = Division(A=notch_radius, B=1.414215)
# This is the actual notch size.
# The one shown in the slider
# is the diameter of the
# circumcircle… (math!)
actual_notch_size = Panel(division_2)
rectangle = Rectangle(Plane=PlaneXY(0, 0, 0), XSize=_4x_notch_radius, YSize=_3x_notch_radius, Radius=0)  # -> Rectangle, Length
polygon = Polygon(Plane=PlaneXY(0, 0, 0), Radius=triangleradius, Segments=number_slider, FilletRadius=0)  # -> Polygon, Length
# This is a single
# notch on the
# connector pieces
# (1.01x larger than
# piece notch)
polygon_2 = Polygon(Plane=PlaneXY(0, 0, 0), Radius=expr("x*1.01", notch_radius), Segments=notch_shape, FilletRadius=0)  # -> Polygon, Length
multiplication_4 = Multiplication(A=multiplication_3, B=2)
pt_2 = ConstructPoint(XCoordinate=division_3, YCoordinate=0, ZCoordinate=0)
# Creates the polar array
# of notches that corresponds
# to the number of sides,
# and rotates it to match the
# middle of the triangle side.
polygon_3 = Polygon(Plane=PlaneXY(0, 0, 0), Radius=notch_radius, Segments=notch_shape, FilletRadius=0)  # -> Polygon, Length
# Notch for
# each side
arrpolar = PolarArray(Geometry=cir, Plane=pt, Count=number_slider, Angle=6.283185307)  # -> Geometry, Transform
pt_3 = ConstructPoint(XCoordinate=expr("x/2", actual_notch_size), YCoordinate=expr("x/2", _3x_notch_radius), ZCoordinate=0)
rotate = Rotate(Geometry=polygon_2.Polygon, Angle=0.7853981634, Plane=PlaneXY(0, 0, 0))  # -> Geometry, Transform
subtraction = Subtraction(A=addition, B=half_notch_size)
rotate_2 = Rotate(Geometry=polygon_3.Polygon, Angle=0.7853981634, Plane=PlaneXY(0, 0, 0))  # -> Geometry, Transform
rotate_3 = Rotate(Geometry=polygon.Polygon, Angle=3.141592654, Plane=pt_2)  # -> Geometry, Transform
move = Move(Geometry=rotate.Geometry, Motion=pt_3)  # -> Geometry, Transform
pt_4 = ConstructPoint(XCoordinate=subtraction, YCoordinate=0, ZCoordinate=0)
rectangle_2 = Rectangle(Plane=construct_point, XSize=multiplication_2, YSize=multiplication_2, Radius=0)  # -> Rectangle, Length
rectangle_3 = Rectangle(Plane=construct_point, XSize=number_slider_3, YSize=number_slider_3, Radius=0)  # -> Rectangle, Length
rectangle_4 = Rectangle(Plane=construct_point, XSize=multiplication_3, YSize=multiplication_3, Radius=0)  # -> Rectangle, Length
rectangle_5 = Rectangle(Plane=construct_point, XSize=multiplication_4, YSize=multiplication_4, Radius=0)  # -> Rectangle, Length
# Single
# notch
# side
rdiff = RegionDifference(CurvesA=rectangle.Rectangle, CurvesB=move.Geometry)
pt_5 = ConstructPoint(XCoordinate=expr("1.49*x", _4x_notch_radius), YCoordinate=expr("1.128*x", actual_notch_size), ZCoordinate=0)
move_2 = Move(Geometry=rotate_2.Geometry, Motion=pt_4)  # -> Geometry, Transform
# Shape without
# notches
rdiff_2 = RegionDifference(CurvesA=rotate_3.Geometry, CurvesB=arrpolar.Geometry)
# Flip to construct
# second notch side
mirror = Mirror(Geometry=rdiff, Plane=PlaneYZ(0, 0, 0))  # -> Geometry, Transform
merge = Merge(Data1=rectangle_3.Rectangle, Data2=rectangle_2.Rectangle, Data3=rectangle_4.Rectangle, Data4=rectangle_5.Rectangle)
# Shape without
# notches
arrpolar_2 = PolarArray(Geometry=move_2.Geometry, Plane=pt, Count=number_slider, Angle=6.283185307)  # -> Geometry, Transform
move_3 = Move(Geometry=mirror.Geometry, Motion=pt_5)  # -> Geometry, Transform
# Duplicate
# the first
# notch side
dup = DuplicateData(Data=rdiff, Number=1, Order=True)
rotate_4 = Rotate(Geometry=move_3.Geometry, Angle=-0.523599, Plane=PlaneXY(0, 0, 0))  # -> Geometry, Transform
# Carving the
# notches in the
# main piece
rdiff_3 = RegionDifference(CurvesA=rdiff_2, CurvesB=arrpolar_2.Geometry)
# Necessary for
# the right merging
# (no idea why)
pshift = ShiftPaths(Data=dup, Offset=-1)
multiplication_5 = Multiplication(A=triangleradius, B=1.66666)
# MOAR (or less) pieces
number_slider_4 = Slider(1.95, range=1..10)
# Moving the connector
# pieces to fit in between
# main pieces
pt_6 = ConstructPoint(XCoordinate=0, YCoordinate=expr("x/1.25", triangleradius), ZCoordinate=0)
merge_2 = Merge(Data1=rotate_4.Geometry, Data2=pshift)
# Area to draw
# multiple pieces
rectangle_6 = Rectangle(Plane=PlaneXY(0, 0, 0), XSize=multiplication_5, YSize=multiplication_5, Radius=0)  # -> Rectangle, Length
# COMPLETE
# NOTCH
runion = RegionUnion(Curves=merge_2)
move_4 = Move(Geometry=runion, Motion=pt_6)  # -> Geometry, Transform
# Rectangular array
# of connector pieces
arrrec = RectangularArray(Geometry=move_4.Geometry, Cell=rectangle_6.Rectangle, XCount=expr("x+1", number_slider_4), YCount=number_slider_4)  # -> Geometry, Transform
# Array of
# main pieces
arrrec_2 = RectangularArray(Geometry=rdiff_3, Cell=rectangle_6.Rectangle, XCount=number_slider_4, YCount=number_slider_4)  # -> Geometry, Transform
